# Grasshopper definition ps_parametric.gh (Grasshopper 1.0.8)
# plug-ins: LunchBox

bow_length = Slider(100, range=2..100)
bow_bottom_radius = Slider(0.527, range=0.01..0.99)
bow_width = Slider(25.414, range=2..30)
bow_top_radius = Slider(0.83, range=0.01..0.99)

slot_width = Slider(87.643, range=10..100)
hull_length = Slider(250.728, range=100..400)

bilge_radius = Slider(0.232, range=0.01..1)
draught = Slider(17.836, range=2..30)

int = Integer(2)
mesh_height_above_0 = Slider(2.836, range=0..10)
panel = Panel("""14
13
21
20
12
0
3
8
18
19""")
list = ValueList({"On": 1, "Off": 0}, selected="Off")

int_2 = Integer(2)
multiplication = Multiplication(A=draught, B=bilge_radius)
multiplication_2 = Multiplication(A=draught, B=bow_bottom_radius)
division = Division(A=bow_width, B=int)
multiplication_3 = Multiplication(A=bow_width, B=int_2)
neg = Negative(Value=hull_length)
multiplication_4 = Multiplication(A=division, B=bow_top_radius)
neg_2 = Negative(Value=draught)
int_3 = Integer(0)
division_2 = Division(A=slot_width, B=int)
addition = Addition(A=slot_width, B=multiplication_3)
division_3 = Division(A=addition, B=int_2)
neg_3 = Negative(Value=division_2)
merge = Merge(
    Data1=multiplication,
    Data2=multiplication_2,
    Data3=multiplication,
    Data4=multiplication,
    Data5=multiplication,
    Data6=multiplication,
    Data7=multiplication,
    Data8=multiplication_4,
    Data9=multiplication_4,
    Data10=multiplication_4)

neg_4 = Negative(Value=division_3)
pt = ConstructPoint(XCoordinate=int_3, YCoordinate=neg_4, ZCoordinate=neg_2)
pt_2 = ConstructPoint(XCoordinate=bow_length, YCoordinate=neg_3, ZCoordinate=mesh_height_above_0)
box = Box2Pt(PointA=pt, PointB=pt_2, Plane=PlaneXY(0, 0, 0))

neg_5 = Negative(Value=division_3)
pt_3 = ConstructPoint(XCoordinate=int_3, YCoordinate=int_3, ZCoordinate=neg_2)
pt_4 = ConstructPoint(XCoordinate=neg, YCoordinate=neg_5, ZCoordinate=mesh_height_above_0)
box_2 = Box2Pt(PointA=pt_3, PointB=pt_4, Plane=PlaneXY(0, 0, 0))

merge_2 = Merge(Data1=box, Data2=box_2)
sunion = SolidUnion(Breps=merge_2)
filedge = FilletEdge(Shape=sunion, Blend=0, Metric=0, Edges=panel, Radii=merge)

sunion_2 = SolidUnion(Breps=filedge)
fmerge = MergeFaces(Brep=sunion_2)  # -> Breps, Before, After
list_2 = ValueList({"On": 1, "Off": 0, "Strict": 2}, selected="Off")
parameters = QuadRemeshParameters(
    TargetQuadCount=Slider(1371.995, range=250..3000),
    UseAdaptiveQuads=True,
    AdaptiveQuadSize=Slider(100, range=10..100),
    DetectHardEdges=True,
    PreserveMeshArrayHardEdges=list_2,
    SymmetryAxis=list,
    GuideCurveInfluence=0,
    TargetEdgeLength=0)
edges = BrepEdges(Brep=fmerge.Breps)  # -> Naked, Interior, NonManifold
remesh = QuadRemesh(MeshOrBrep=fmerge.Breps, QuadRemeshParameters=parameters, GuideCurves=edges.Interior)
demesh = DeconstructMesh(Mesh=remesh)  # -> Vertices, Faces, Colours, Normals

pln = Plane(PlaneXZ(-0.3926773101, 0, -2.436866212))
mirror = Mirror(Geometry=filedge, Plane=pln)  # -> Geometry, Transform
merge_3 = Merge(Data1=mirror.Geometry, Data2=filedge)
sunion_3 = SolidUnion(Breps=merge_3)
fmerge_2 = MergeFaces(Brep=sunion_3)  # -> Breps, Before, After
list_3 = ValueList({"On": 1, "Off": 0, "Strict": 2}, selected="Off")
list_4 = ValueList({"On": 1, "Off": 0}, selected="On")
edges_2 = BrepEdges(Brep=fmerge_2.Breps)  # -> Naked, Interior, NonManifold
parameters_2 = QuadRemeshParameters(
    TargetQuadCount=Slider(1371.995, range=250..3000),
    UseAdaptiveQuads=True,
    AdaptiveQuadSize=Slider(100, range=10..100),
    DetectHardEdges=True,
    PreserveMeshArrayHardEdges=list_3,
    SymmetryAxis=list_4,
    GuideCurveInfluence=0,
    TargetEdgeLength=0)
remesh_2 = QuadRemesh(MeshOrBrep=fmerge_2.Breps, QuadRemeshParameters=parameters_2, GuideCurves=edges_2.Interior)
demesh_2 = DeconstructMesh(Mesh=remesh_2)  # -> Vertices, Faces, Colours, Normals

facen = FaceNormals(Mesh=remesh)  # -> Centers, Normals
medges = MeshEdges(Mesh=remesh_2)  # -> NakedEdges, InteriorEdges, NonManifoldEdges
facen_2 = FaceNormals(Mesh=remesh_2)  # -> Centers, Normals

panel_2 = Panel(demesh.Vertices)
panel_3 = Panel(demesh.Faces)
panel_4 = Panel(facen.Centers)
panel_5 = Panel(facen.Normals)

panel_6 = Panel(demesh_2.Vertices)
panel_7 = Panel(demesh_2.Faces)
panel_8 = Panel(facen_2.Centers)
panel_9 = Panel(facen_2.Normals)

save_full_mesh = Button()
path = FilePath("C:\Users\Albert Aperghis\Documents\1. TU Delft\02. MSc\Numerical Ship Hydromechanics\Potential_flow_assignment\src\data\")
py3 = Python3Script(
    mode="double",
    vertices=panel_6,
    faces=panel_7,
    centres=panel_8,
    normals=panel_9,
    directory=path,
    length=hull_length,
    slot_width=slot_width,
    bow_width=bow_width,
    bow_radius_top=bow_top_radius,
    bow_radius_bottom=bow_bottom_radius,
    bow_length=bow_length,
    draught=draught,
    bilge_radius=bilge_radius,
    activate=save_full_mesh)  # -> data; inputs vertices: list, faces: list, centres: list, normals: list, activate: Boolean
# ---------- py3: Python ----------
import datetime
import json

def get_timestamp():
    """
    Returns the current date and time formatted as YYYYMMDD_HH-MM.
    """
    return datetime.datetime.now().strftime("%m%d_%H-%M")
"""
Encodes the provided hull data into a filename.

The floats are formatted to two decimals with the decimal point replaced.
Example output: PS_hull_L30p50_SW5p25_D2p75_BR1p50.stp
"""

timestamp = get_timestamp()
filename = f"PS_hull_{timestamp}_{mode}.json" 
data = {"ship_info":{"length": length,
                        "slot_width": slot_width,
                        "bow": {"width": bow_width,
                                "radius_top": bow_radius_top,
                                "radius_side": bow_radius_bottom,
                                "lenght": bow_length},
                        "draught": draught,
                        "bilge_radius": bilge_radius},
            "verts": vertices,
            "faces": faces,
            "centres": centres,
            "normals": normals}


if activate:
    with open(directory+filename, mode="w+") as f:
        json.dump(data, f)
# ---------- end py3 ----------
panel_10 = Panel(py3)

save_half_mesh = Button()
path_2 = FilePath("C:\Users\Albert Aperghis\Documents\1. TU Delft\02. MSc\Numerical Ship Hydromechanics\Potential_flow_assignment\src\data\")
py3_2 = Python3Script(
    mode="double",
    vertices=panel_2,
    faces=panel_3,
    centres=panel_4,
    normals=panel_5,
    directory=path_2,
    length=hull_length,
    slot_width=slot_width,
    bow_radius_top=bow_top_radius,
    bow_radius_bottom=bow_bottom_radius,
    bow_length=bow_length,
    draught=draught,
    bilge_radius=bilge_radius,
    activate=save_half_mesh)  # -> data; inputs vertices: list, faces: list, centres: list, normals: list, activate: Boolean; same code as py3
panel_11 = Panel(py3_2)
